# Grasshopper definition Terraforming.gh (Grasshopper 1.0.7)

water_depth_factor = Slider(5, range=0..30)
smooth_factor = Slider(10, range=0..30)
x0 = Slider(0, range=-10..0)
x1 = Slider(100, range=0..100)
y0 = Slider(0, range=-10..0)
y1 = Slider(100, range=0..100)
steps_x = Slider(210, range=0..300)
steps_y = Slider(300, range=0..300)
building = Mesh(<mesh referenced from the Rhino model>)
water = Curve(<curve referenced from the Rhino model>)
roads = Curve([<curve referenced from the Rhino model> x2])
create_land = CSharpScript(
    x0=x0,
    x1=x1,
    y0=y0,
    y1=y1,
    steps_x=steps_x,
    steps_y=steps_y,
    smooth_factor=smooth_factor,
    crv_water=water,
    water_depth_factor=water_depth_factor,
    crv_roads=roads,
    building=building)  # -> out, A, baseland, watermesh, road1mesh, road2mesh, plants, noplants; inputs x0: Double, x1: Double, y0: Double, y1: Double, steps_x: Int32, steps_y: Int32, smooth_factor: Int32, crv_water: Curve, water_depth_factor: Int32, crv_roads: list of Curve, building: Mesh
# ---------- create_land: C# usings ----------
using System.IO;
using System.Linq;
using System.Data;
using System.Drawing;
using System.Reflection;
using System.Windows.Forms;
using System.Xml;
using System.Xml.Linq;
using System.Runtime.InteropServices;

using Rhino.DocObjects;
using Rhino.Collections;
using GH_IO;
using GH_IO.Serialization;
# ---------- create_land: C# ----------
    //calculate grid steps
    double length = x1 - x0;
    double width = y1 - y0;
    double dx = length / (double) (steps_x - 1.0);
    double dy = width / (double) (steps_y - 1.0);

    //points for base landscape
    List<Point3d> land = new List<Point3d>();

    //points for water
    List<Point3d> water_pts = new List<Point3d>();

    //points for road1
    List<Point3d> road1_pts = new List<Point3d>();
    //points for road2
    List<Point3d> road2_pts = new List<Point3d>();


    //generate the surface points
    for(int j = 0; j < steps_y; ++j) {
      for(int i = 0; i < steps_x; ++i) {
        double x = x0 + i * dx;
        double y = y0 + j * dy;

        Point3d point = new Point3d(x, y, 0.0);

        //smooth land transitioning
        double t = (( x - x0) / length + (y - y0) / width) / 2;
        t = t * t;
        //create surface undulation
        double z0 = smooth_factor * Math.Cos(0.01 * x) * Math.Sin(0.1 * y);
        double z1 = (y) *0.4;
        double z = z0 * (1.0 - t) + z1 * t;

        //creating water
        //calculate the distance along the water curve where the closest point to the given point lies
        double d_waterorigin;
        // evaluate the closest point on the water curve using the parameter value
        crv_water.ClosestPoint(point, out d_waterorigin);
        Point3d cp = crv_water.PointAt(d_waterorigin);
        // calculate the distance between the given point and the closest point on the water curve
        double d_water = point.DistanceTo(cp);

        //d_waterorigin normalized to express percentage along water
        d_waterorigin = d_waterorigin / crv_water.GetLength();
        //water depth given as a sin function
        double depth = water_depth_factor * d_waterorigin * Math.Sin(10 * d_waterorigin + 50) + 4;
        //check point in water
        bool in_water = point.Y > cp.Y && d_water < 3 || point.Y < cp.Y && d_water < 1;

        //wider north side
        if (point.Y > cp.Y && d_water < 3) {
          //decreasing depth along river banks
          z = z - (10 - d_water * d_water) / 10 * Math.Abs(depth);
          water_pts.Add(new Point3d(x, y, z));
        }
          //narrower south side
        else if (point.Y < cp.Y && d_water < 1) {
          z = z - (1 - d_water * d_water) * Math.Abs(depth);
          water_pts.Add(new Point3d(x, y, z));
        }
        else {
          //creating road1
          double d_road1 = 0.0;
          crv_roads[0].ClosestPoint(point, out d_road1);
          Point3d cp_road1 = crv_roads[0].PointAt(d_road1);
          d_road1 = point.DistanceTo(cp_road1);
          bool in_r1 = d_road1 < 5;

          //creating road2
          double d_road2 = 0.0;
          crv_roads[1].ClosestPoint(point, out d_road2);
          Point3d cp_road2 = crv_roads[1].PointAt(d_road2);
          d_road2 = point.DistanceTo(cp_road2);

          //z will be same as that of the surface
          //road1
          if (d_road1 < 5) {
            double z0_r1 = smooth_factor * Math.Cos(0.01 * cp_road1.X) * Math.Sin(0.1 * cp_road1.Y);
            double z1_r1 = 0.3 * cp_road1.Y;
            double t_r1 = (( cp_road1.X - x0) / length + (cp_road1.Y - y0) / width) / 2;
            t_r1 = t_r1 * t_r1;
            z = z1_r1 * t_r1 + z0_r1 * (1 - t_r1) + 0.5;
            road1_pts.Add(new Point3d(x, y, z));
          }
            //road2
          else if (d_road2 < 5) {
            double z0_r2 = smooth_factor * Math.Cos(0.01 * cp_road2.X) * Math.Sin(0.1 * cp_road2.Y);
            double z1_r2 = 0.3 * cp_road2.Y;
            double t_r2 = ((cp_road2.X - x0) / length + (cp_road2.Y - y0) / width) / 2;
            t_r2 = t_r2 * t_r2;
            z = z1_r2 * t_r2 + z0_r2 * (1 - t_r2) + 0.5;
            road2_pts.Add(new Point3d(x, y, z));
          }

          else{
            //create base mesh for land and dip for water
            //create a test point
            Point3d test_pt = new Point3d(x, y, z);
            //max Z value in the building mesh
            double bZ = maxZ(building);
            //point inside building, z becomes level with bZ
            if (building.IsPointInside(test_pt, 0.1, false)) {z = bZ;
            }else{
              double dist_b = Dist(test_pt, building);
              //test_pt near building
              if (dist_b < 25){
                double t3 = 1 / (1 + Math.Pow((dist_b / 5.0), 2.0));
                //test_pt away from building
                if (dist_b > 15){t3 = (25 - dist_b) / 100;}

                z = (1 - t3) * test_pt.Z + t3 * bZ;
              }
            }
          }

        }
        Point3d land_pt = new Point3d(x, y, z);
        land.Add(land_pt);
      }
    }
    //create meshes for water and roads
    Mesh waterMesh = Mesh.CreateFromTessellation(water_pts, null, Plane.WorldXY, false);
    Mesh road1Mesh = Mesh.CreateFromTessellation(road1_pts, null, Plane.WorldXY, false);
    Mesh road2Mesh = Mesh.CreateFromTessellation(road2_pts, null, Plane.WorldXY, false);

    //remove mesh triangles
    List<int> bad_water = new List<int>();
    RemoveBadtri(bad_water, waterMesh);
    List<int> bad_road0 = new List<int>();
    RemoveBadtri(bad_road0, road1Mesh);
    List<int> bad_road1 = new List<int>();
    RemoveBadtri(bad_road1, road2Mesh);

    //create mesh for land
    Mesh landmesh = Mesh.CreateFromTessellation(land, null, Plane.WorldXY, false);
    landmesh.Normals.ComputeNormals();

    //derive plantable area
    Mesh plantable = (Mesh) landmesh.Duplicate();
    List<int> extract = new List<int>();
    for (int i = 0; i < plantable.Faces.Count; i++){

      Point3d p1 = plantable.Vertices[plantable.Faces[i].A];
      Point3d p2 = plantable.Vertices[plantable.Faces[i].B];
      Point3d p3 = plantable.Vertices[plantable.Faces[i].C];

      Point3d centroid = (p1 + p2 + p3) / 3;
      Point3d centroidFlat = new Point3d (centroid.X, centroid.Y, 0);

      double d_waterorigin;
      crv_water.ClosestPoint(centroidFlat, out d_waterorigin);
      Point3d cp = crv_water.PointAt(d_waterorigin);
      double d_water = centroidFlat.DistanceTo(cp);

      bool waterN = centroidFlat.Y > cp.Y && d_water < 3.5;
      bool waterS = centroidFlat.Y < cp.Y && d_water < 1.5;

      if (waterN || waterS || Dist(centroidFlat, crv_roads[0]) < 5.5 || Dist(centroidFlat, crv_roads[1]) < 5.5){
        extract.Add(i);
      }
    }
    Mesh unplantable = plantable.Faces.ExtractFaces(extract);

    landmesh.Normals.ComputeNormals();
    waterMesh.Normals.ComputeNormals();
    road1Mesh.Normals.ComputeNormals();
    road2Mesh.Normals.ComputeNormals();
    plantable.Normals.ComputeNormals();

    //outputs
    //A = land;
    baseland = landmesh;
    watermesh = waterMesh;
    road1mesh = road1Mesh;
    road2mesh = road2Mesh;
    plants = plantable;
    noplants = unplantable;
# ---------- create_land: C# additional code ----------
  //Closest point to curve
  Point3d ClosestPt(Point3d p, Curve c0) {
    double t = 0.0;
    c0.ClosestPoint(p, out t);
    Point3d cp = c0.PointAt(t);
    return cp;
  }

  //Maximum z-point on the mesh
  double maxZ(Mesh m){
    double maxZ = Double.MinValue;
    foreach (Point3d p in m.Vertices){
      if (p.Z > maxZ) maxZ = p.Z;
    }
    return maxZ;
  }

  //Closest distance from a point to mesh
  double Dist(Point3d p, Mesh m0) {
    Point3d cp = m0.ClosestPoint(p);
    return p.DistanceTo(cp);
  }

  //Distance between 2 points
  double Dist(Point3d p, Point3d p0) {
    return p.DistanceTo(p0);
  }

  double Dist(Point3d p, Curve c0) {
    double t = 0.0;
    c0.ClosestPoint(p, out t);
    Point3d cp = c0.PointAt(t);
    return p.DistanceTo(cp);
  }

  //Remove extra trianles from the mesh
  void RemoveBadtri(List < int> badtri, Mesh m){
    for (int i = 0; i < m.Faces.Count; i++){
      Point3d p1 = m.Vertices[m.Faces[i].A];
      Point3d p2 = m.Vertices[m.Faces[i].B];
      Point3d p3 = m.Vertices[m.Faces[i].C];

      double d1 = Dist(p1, p2);
      double d2 = Dist(p1, p3);
      double d3 = Dist(p2, p3);

      if (d1 > 10 || d2 > 10 || d3 > 10) {
        badtri.Add(i);
      }
    }
    m.Faces.ExtractFaces(badtri);
  }
# ---------- end create_land ----------
plants_partition = CSharpScript(m=create_land.plants)  # -> out, A, B; inputs m: Mesh
# ---------- plants_partition: C# ----------
    //this will be the list of face indices
    //that will be isolated from the mesh
    List<int> facesA = new List<int>();

    //ensure the mesh has Face normals
    m.FaceNormals.ComputeFaceNormals();


    for(int i = 0; i < m.Faces.Count; ++i) {
      //get the center and normal of each face [i]
      Point3d fcen = m.Faces.GetFaceCenter(i);
      Vector3d fn = m.FaceNormals[i];

      //if the normal is facing towards the negative Y (south) then add the corresponding face index
      //to the list to be extracted
      if (fn.Y < 0.0) facesA.Add(i);

    }

    //decompose the mesh by extracting all the faces we stored in the list
    Mesh m1 = m.Faces.ExtractFaces(facesA);

    A = m1;
    B = m;
# ---------- end plants_partition ----------
custom_preview = CustomPreview(Geometry=create_land.watermesh, Material=ColourSwatch(SwatchColor=RGBA(0, 72, 255, 169)))
custom_preview_2 = CustomPreview(Geometry=plants_partition.A, PlantableMoreSun=ColourSwatch(SwatchColor=RGB(69, 177, 102)))
custom_preview_3 = CustomPreview(Geometry=plants_partition.B, PlantableLessSun=ColourSwatch(SwatchColor=RGB(151, 255, 125)))
custom_preview_4 = CustomPreview(
    Geometry=[create_land.noplants, building, create_land.road2mesh, create_land.road1mesh],
    Material=ColourSwatch(SwatchColor=RGB(156, 156, 156)))
geometry = Geometry(<mesh referenced from the Rhino model>)
trees = CSharpScript(m=plants_partition.A)  # -> out, n, point, trees, trunks; inputs m: Mesh
# ---------- trees: C# ----------
    //this will be the list of face indices
    //that will be isolated from the mesh
    List<int> facesA = new List<int>();
    List<int> facesB = new List<int>();
    List<Vector3d> ns = new List<Vector3d>();
    List<Point3d> pts = new List<Point3d>();

    //ensure the mesh has Face normals
    m.FaceNormals.ComputeFaceNormals();


    for(int i = 0; i < m.Faces.Count; ++i) {
      //get the center and normal of each face [i]
      Point3d fcen = m.Faces.GetFaceCenter(i);
      Vector3d fn = m.FaceNormals[i];

      if (fn.Z > 0.5){
        ns.Add(fn);
        pts.Add(fcen);
      }

    }

    List<Brep> tree = new List<Brep>();
    List<Brep> trunk = new List<Brep>();


    int iterator = pts.Count / 50;
    int remainder = pts.Count % 50;
    for (int i = 0; i < pts.Count - remainder; i += iterator){
      Point3d p = pts[i];
      Point3d p_tree = new Point3d(p.X, p.Y, (p.Z + p.Z / 5 + 1.5));
      Rhino.Geometry.Sphere s = new Rhino.Geometry.Sphere(p_tree, (p.Z / 10 + 1) * ns[i].Z);
      tree.Add(s.ToBrep());

      Rhino.Geometry.Circle c = new Rhino.Geometry.Circle(p_tree, p.Z / 70 + 0.1);
      Rhino.Geometry.Cylinder cy = new Rhino.Geometry.Cylinder(c, -p.Z / 5 - 2);
      trunk.Add(cy.ToBrep(true, true));


    }



    n = ns;
    point = pts;
    trees = tree;
    trunks = trunk;
# ---------- end trees ----------
shrubs = CSharpScript(bush=geometry, m=plants_partition.B)  # -> out, bushes, bushroots; inputs bush: GeometryBase, m: Mesh
# ---------- shrubs: C# ----------
    List<Vector3d> nsA = new List<Vector3d>();
    List<Point3d> ptsA = new List<Point3d>();

    //ensure the mesh has Face normals
    m.FaceNormals.ComputeFaceNormals();

    //gets all pts and normals of mesh
    for(int i = 0; i < m.Faces.Count; ++i) {
      //get the center and normal of each face [i]
      Point3d fcen = m.Faces.GetFaceCenter(i);
      Vector3d fn = m.FaceNormals[i];

      if (fn.Z > 0.7){
        nsA.Add(fn);
        ptsA.Add(fcen);
      }
    }

    List<Vector3d> ns_bush = new List<Vector3d>();
    List<Point3d> pts_bush = new List<Point3d>();


    //gets 30 pts and their normals to create bushes
    int iterator = ptsA.Count / 30;
    int remainder = ptsA.Count % 30;
    for (int i = 0; i < ptsA.Count - remainder; i += iterator){
      pts_bush.Add(ptsA[i]);
      ns_bush.Add(nsA[i]);
    
     }
    

    List<GeometryBase> bushlist = new List<GeometryBase>();

    BoundingBox box_bush = bush.GetBoundingBox(true);
    Point3d root_bush = new Point3d(box_bush.Center.X, box_bush.Center.Y, box_bush.Center.Z - 0.75);


    for(int i = 0; i < pts_bush.Count; ++i) {
      Vector3d toPoint = pts_bush[i] - box_bush.Center;
      Transform T = Transform.Translation(toPoint);
      double sFactor = 0.3 + pts_bush[i].Z / 50;
      Transform S = Transform.Scale(box_bush.Center, sFactor);

      GeometryBase bush2 = bush.Duplicate();

      Plane bushPlane = new Plane(root_bush, Vector3d.ZAxis);
      Plane tPlane = new Plane(pts_bush[i], ns_bush[i]);
      Transform TR = Transform.PlaneToPlane(bushPlane, tPlane);

      bush2.Transform(TR * S);
      bushlist.Add(bush2);
    }


    bushes = bushlist;
    bushroots = pts_bush;
# ---------- end shrubs ----------
custom_preview_5 = CustomPreview(Geometry=trees.trees, Material=ColourSwatch(SwatchColor=RGBA(28, 94, 34, 155)))
custom_preview_6 = CustomPreview(Geometry=trees.trunks, Material=ColourSwatch(SwatchColor=RGB(135, 91, 24)))
custom_preview_7 = CustomPreview(Geometry=shrubs.bushes, Material=ColourSwatch(SwatchColor=RGBA(53, 171, 63, 207)))
